# Grasshopper definition Animated Systems- Aditya Ambare-UGUNS Pavillion.gh (Grasshopper 1.0.7)

construct_point = ConstructPoint(XCoordinate=Slider(200, range=0..200), YCoordinate="0", ZCoordinate="0")
point = Point(construct_point)

unit_x = UnitX(Factor=Slider(250, range=0..500))
move = Move(Geometry=point, Motion=unit_x)  # -> Geometry, Transform

line = Line(StartPoint=point, EndPoint=move.Geometry)

# ---- group: Extrusion
unit_z = UnitZ(Factor=Slider(10, range=0..10))
extrude = Extrude(Base=line, Direction=unit_z)

# ----
number_slider = Slider(161, range=0..1000)

# ---- group: Blocks
box_rectangle = BoxRectangle(Rectangle=extrude, Height=Slider(10, range=0..100))

# ---- group: Vertical Array the blocks
linear_array = LinearArray(Geometry=box_rectangle, Direction=unit_z, Count=Slider(60, range=0..100))  # -> Geometry, Transform

# ---- group: Distribution of alternate rows of blocks
panel = Panel("""1
0""")
panel_2 = Panel("""0
1""")
cull_pattern = CullPattern(List=linear_array.Geometry, CullPattern=panel_2)
cull_pattern_2 = CullPattern(List=linear_array.Geometry, CullPattern=panel)

# ----
length = Slider(200, range=0..300)

# ---- group: Graph Mapper for Rotation Angles
list_length = ListLength(List=cull_pattern)
series = Series(Start=Slider(0, range=0..100), Step=Slider(2, range=0..100), Count=list_length)
graph_mapper = GraphMapper(
    series,
    x0=50,
    x1=0,
    y0=0,
    y1=50,
    container_name="Bezier",
    cpx=[0, 0, 0.379471153, 1],
    cpy=[0.01316148043, 0, 0.7041513324, 0.3782315254])

# ---- group: Rotation of the blocks
addition = Addition(A=length, B=Slider(200, range=0..300))
construct_point_2 = ConstructPoint(XCoordinate=addition, YCoordinate=0, ZCoordinate=0)
point_2 = Point(construct_point_2)
xy_plane = XYPlane(Origin=point_2)
negative = Negative(Value=graph_mapper)
rotate = Rotate(Geometry=cull_pattern, Angle=degrees(graph_mapper), Plane=xy_plane)  # -> Geometry, Transform
rotate_2 = Rotate(Geometry=cull_pattern_2, Angle=degrees(negative), Plane=xy_plane)  # -> Geometry, Transform

# ----
brep_join = BrepJoin(Breps=[rotate.Geometry, rotate_2.Geometry])  # -> Breps, Closed

# ---- group: Polar Array
xy_plane_2 = XYPlane(Origin=Point(0, 0, 0))
polar_array = PolarArray(Geometry=brep_join.Breps, Plane=xy_plane_2, Count=Slider(10, range=0..10), Angle=degrees(Slider(324, range=0..1000)))  # -> Geometry, Transform
